# Grasshopper definition slicer.gh (Grasshopper 1.0.7)

shrinkage = Slider(0, range=0..1)
shrink_resize = ShrinkResize(x=shrinkage)
trigger = Trigger(Interval=-1000, TimerInterval=1000, Target=python)
layer_height = Slider(0.3, range=0..1)
extrude_width = Slider(0.75, range=0..1)
nozzle_width = Slider(6.5, range=1..8)
nozzle_height = Slider(10, range=0..30)
pt = Point(<point referenced from the Rhino model>)
geo = Geometry(<brep referenced from the Rhino model>)
dam = DataDam(
    DataModel=geo,
    DataLayerHeight=layer_height,
    DataExtrudeWidth=extrude_width,
    DataNozzleWidth=nozzle_width,
    DataNozzleHeight=nozzle_height,
    DataC=pt,
    BufferDelay=10000000,
    BufferMode=0)  # -> DataModel, DataLayerHeight, DataExtrudeWidth, DataNozzleWidth, DataNozzleHeight, DataC
geo_2 = Geometry()
python = GhPythonScript()  # -> out, file
# ---------- python: Python ----------
import rhinoscriptsyntax as rs

filter = "GCode (*.gcode)|*.gcode|All Files (*.*)|*.*||"
file = rs.SaveFileName("", filter)
# ---------- end python ----------
python_2 = GhPythonScript(shape=geo_2, layer=Slider(171, range=0..200))  # -> out, a
# ---------- python_2: Python ----------
import rhinoscriptsyntax as rs


a = rs.AddSrfContourCrvs(shape, rs.PlaneFromNormal([0, 0, layer*0.3], [0, 0, 1]))
# ---------- end python_2 ----------
pt_2 = ConstructPoint(XCoordinate=0, YCoordinate=0, ZCoordinate=0.01)
dam_2 = DataDam(DataA=python.file, BufferDelay=10000000, BufferMode=0)
contour = Contour(Shape=dam.DataModel, Point=pt_2, Direction=Vector(0, 0, 1), Distance=dam.DataLayerHeight)
geo_3 = Geometry(python_2.a)
python_3 = GhPythonScript(
    filename=dam_2,
    curves=dam.DataModel,
    layer_height=dam.DataLayerHeight,
    extrude_width=dam.DataExtrudeWidth,
    nozzle_width=dam.DataNozzleWidth,
    nozzle_height=dam.DataNozzleHeight,
    start_point=dam.DataC)  # -> out, lines, turtle, print_bed, travel, splits, tree, path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; inputs curves: Brep, start_point: Point3d
# ---------- python_3: Python ----------
# code required so that library reloads appropriately
# must be above other import statements
import sys
import math
import time
import operator as op
to_delete = list()
for module in sys.modules:
    if "tree_utils" in module:
      to_delete.append(module)
    if "graph_utils" in module:
      to_delete.append(module)
    if "image_utils" in module:
      to_delete.append(module)
    if "contour_utils" in module:
      to_delete.append(module)
    if "geometry_utils" in module:
      to_delete.append(module)
    if "vertical_utils" in module:
      to_delete.append(module)
    if "slicing_utils" in module:
      to_delete.append(module)
    if "extruder_turtle" in module:
      to_delete.append(module)
    if "turtle_utilities" in module:
      to_delete.append(module)
for module in to_delete:
    sys.modules.pop(module)

import slicing_utils
from slicing_utils import *

import vertical_utils
from vertical_utils import *

import extruder_turtle
from extruder_turtle import *

import turtle_utilities as tu

import Rhino
import rhinoscriptsyntax as rs

reload(slicing_utils)
reload(extruder_turtle)


# Main code
# set up the turtle
t = ExtruderTurtle()
t.setup(filename=filename, printer = "eazao")

# metal settings
t.set_material('metal')

t.set_layer_height(layer_height)
t.set_extrude_width(extrude_width)

t.set_nozzle_height(nozzle_height)
t.set_nozzle_width(nozzle_width)

print("layer height is: " +str(t.get_layer_height()))
print("extrude rate is: "+str(t.get_extrude_rate()))
print("extrusion width is: "+str(t.get_extrude_width()))


if start_point != None:
    t.pen_up()
    t.set_position(start_point.X, start_point.Y, 0)
    t.pen_down()

# draw
#travel = slice_contour_fill(t, shape, start=139, end=140, initial_offset=0.0)
#travel = slice_spiral_fill(t, shape, start=134, end=135, initial_offset=0.0)
#travel = slice_fermat_fill(t, shape, start=134, end=135, initial_offset=0.0)
#travel = slice_fermat_fill(t, shape, start=139, end=140, initial_offset=0.0)

#travel, tree, path, edges = slice_vertical_and_fermat_fill(t, curves, wall_mode=True, walls=4, initial_offset=0.0)


# visualize nozzle height splits
splits = []
bb = rs.BoundingBox(curves)
surf = rs.AddSrfPt([bb[0], bb[1], bb[2], bb[3]])
rs.MoveObject(surf, [0, 0, -bb[0].Z])
nozzle_height = t.get_nozzle_height()
#for z_e in range(int(math.floor(rs.CurveStartPoint(curves[-1]).Z / nozzle_height)+1)):
#    splits.append(rs.CopyObject(surf, [0,0,z_e*nozzle_height]))

# visualize edges in graph
#edge_start = [rs.CurveStartPoint(edge) for edge in edges]
#edge_end = [rs.CurveEndPoint(edge) for edge in edges]


# visualize the turtle's path
#turtle = t.draw_turtle()
lines = t.get_lines()
print_bed = t.draw_print_bed()

# close the generated .gcode file
t.finish()
# ---------- end python_3 ----------
crv = Curve(python_3.travel)
crv_2 = Curve(python_3.lines)
srf = Surface(python_3.print_bed)
geo_4 = Geometry(python_3.splits)
panel = Panel(python_3.out)
subtraction = Subtraction(A=python_3.edge_end, B=python_3.edge_start)
pt_3 = Point(python_3.center_points)
geo_5 = Geometry(python_3.bounding_boxes)
cluster = Cluster_2(index=Slider(200, range=1..200))
vdis = VectorDisplay(Anchor=python_3.edge_start, Vector=subtraction)
geo_6 = Geometry(cluster)
cluster_2 = Cluster(N=Slider(500, range=0..1000), B=Slider(0, range=0..15000))

# ==== cluster Cluster
C = ClusterInput()
N = ClusterInput()
B = ClusterInput()
join = JoinCurves(Curves=C, Preserve=False)
divide = DivideCurve(Curve=join, Count=N, Kinks=False)  # -> flatten(Points), Tangents, Parameters
dom = ConstructDomain(DomainStart=0, DomainEnd=B)
subset = SubList(List=divide.Points, Domain=dom, Wrap=True)  # -> List, Index
intcrv = Interpolate(Vertices=subset.List, Degree=3, Periodic=False, KnotStyle=1)  # -> Curve, Length, Domain

# ==== cluster Cluster_2
path = ClusterInput()
center_points = ClusterInput()
index = ClusterInput()
geo = Geometry(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)
python = GhPythonScript(path=path, center_points=center_points, index=index, nozzle=geo)  # -> travel, new_nozzle; inputs path: list, center_points: list, index: Int32
# ---------- python: Python ----------
__author__ = "school"

import rhinoscriptsyntax as rs

travel = []

print(path)

for node in path:
    for sub in node.data.sub_nodes:
        travel.append(sub.start_point)

new_nozzle = rs.CopyObject(nozzle, translation=travel[min(index, len(travel)-1)])
# ---------- end python ----------
new_nozzle = ClusterOutput(python.new_nozzle)

# ==== cluster ShrinkResize
relay = ClusterInput()
x = ClusterInput()
area = Area(Geometry=relay)  # -> Area, Centroid
eval = Evaluate(F="1/(1-x)", x=x)
pt2num = PointsToNumbers(Points=area.Centroid, Mask=4)
item = ListItem(List=pt2num, Index=0, Wrap=True)
item_2 = ListItem(List=pt2num, Index=1, Wrap=True)
vec = VectorXYZ(XComponent=item, YComponent=item_2, ZComponent=0)  # -> Vector, Length
scale = Scale(Geometry=relay, Center=vec.Vector, Factor=eval)  # -> Geometry, Transform
G = ClusterOutput(scale.Geometry)
